# Grasshopper definition data.gh (Grasshopper 1.0.7)

point = Point([<point referenced from the Rhino model> x101])
mesh = Mesh(<mesh referenced from the Rhino model>)
deconstruct_mesh = DeconstructMesh(Mesh=mesh)  # -> Vertices, Faces, Colours, Normals
deconstruct = Deconstruct(Point=point)  # -> XComponent, YComponent, ZComponent
panel = Panel(deconstruct.XComponent)
panel_2 = Panel(deconstruct.YComponent)
panel_3 = Panel(deconstruct.ZComponent)
list_item = ListItem(List=deconstruct_mesh.Faces, Index=Slider(0, range=0..10), Wrap=True)
construct_point = ConstructPoint(XCoordinate=panel, YCoordinate=panel_2, ZCoordinate=panel_3)
panel_4 = Panel(deconstruct_mesh.Faces)
deconstruct_face = DeconstructFace(Face=list_item)  # -> CornerA, CornerB, CornerC, CornerD
panel_5 = Panel(list_item)
panel_6 = Panel(construct_point)
panel_7 = Panel(deconstruct_face.CornerA)
