# Grasshopper definition intersections.gh (Grasshopper 1.0.7)

point = Point([<point referenced from the Rhino model> x50])
panel = Panel(point)
deconstruct = Deconstruct(Point=point)  # -> XComponent, YComponent, ZComponent
number_slider = Slider(200, range=0..1000)
sine = Sine(Value=0)
file_path = FilePath("/Users/lunajiang/Desktop/huaihai/output_z.csv")
cosine = Cosine(Value=0)
read_file = ReadFile(File=file_path, PerLineParse=True)
multiplication = Multiplication(A=cosine, B=number_slider)
multiplication_2 = Multiplication(A=sine, B=number_slider)
addition = Addition(A=deconstruct.XComponent, B=multiplication)
addition_2 = Addition(A=deconstruct.YComponent, B=multiplication_2)
ghpython_script = GhPythonScript(nums=read_file)  # -> out, pointlist; inputs nums: list
# ---------- ghpython_script: Python ----------
import ghpythonlib.components as ghcomp


__author__ = "zmc"
__version__ = "2023.09.22"

pointlist = []


for num0 in nums:
    x = num0.split(',',2)[0]
    y = num0.split(',',2)[1]
    z = num0.split(',',2)[2]
#    print x,y,z
    
    point = ghcomp.ConstructPoint(x,y,z)
    pointlist.append(point)
# ---------- end ghpython_script ----------
panel_2 = Panel(read_file)
panel_3 = Panel(addition)
panel_4 = Panel(addition_2)
panel_5 = Panel(ghpython_script.pointlist)
construct_point = ConstructPoint(XCoordinate=addition, YCoordinate=addition_2, ZCoordinate=Slider(4, range=0..10))
construct_point_2 = ConstructPoint(XCoordinate=addition, YCoordinate=addition_2, ZCoordinate=Slider(3, range=0..10))
construct_point_3 = ConstructPoint(XCoordinate=addition, YCoordinate=addition_2, ZCoordinate=Slider(5, range=0..10))
construct_point_4 = ConstructPoint(XCoordinate=addition, YCoordinate=addition_2, ZCoordinate=Slider(2, range=0..10))
construct_point_5 = ConstructPoint(XCoordinate=addition, YCoordinate=addition_2, ZCoordinate=deconstruct.ZComponent)
line = Line(StartPoint=point, EndPoint=construct_point_3)
line_2 = Line(StartPoint=point, EndPoint=construct_point)
line_3 = Line(StartPoint=point, EndPoint=construct_point_4)
line_4 = Line(StartPoint=point, EndPoint=construct_point_2)
line_5 = Line(StartPoint=point, EndPoint=construct_point_5)
number_slider_2 = Slider(10, range=0..10)
merge = Merge(Data1=line, Data2=line_2, Data3=line_4, Data4=line_3, Data5=line_5)
end_points = EndPoints(Curve=merge)  # -> Start, End
division = Division(A=Slider(360, range=0..1000), B=number_slider_2)
series = Series(Start=Slider(0, range=0..100), Step=number_slider_2, Count=division)
panel_6 = Panel(merge)
radians = Radians(Degrees=series)
rotate = Rotate(Geometry=graft(merge), Angle=radians, Plane=graft(end_points.Start))  # -> Geometry, Transform
mesh = Mesh()
mesh_curve = MeshCurve(Mesh=mesh, Curve=rotate.Geometry)  # -> Points, Faces
panel_7 = Panel(construct_point_5)
surface_curve = SurfaceCurve(Curve=rotate.Geometry)  # -> Curves, Points, UVPoints, Normals, Parameters, Tangents
